% Simulink data dictionary TUM_interfaces.sldd

CartPos = Simulink.Bus()
  x_m: double
  y_m: double
  psi_rad: double

PathPos = Simulink.Bus()
  s_m: double
  d_m: double
  psi_rad: double

SpeedVec = Simulink.Bus()
  vx: double
  vy: double
  beta: double

TUMHealthStatus = enum(DefaultValue="ERROR", StorageType="uint16")
  ERROR = 0
  WARNING = 1
  OK = 2

IC_TUMModeControl = struct(
  TUMVehicleState=TUMVehicleState.OFF,
  EnableSensorFusion=false,
  EnableControlOutputs=false,
  EnableDriver=false)

TUMControlState = enum(DefaultValue="Standstill")
  Standstill = 0
  Slow = 1
  Fast = 2
  Emergency = 3
  Brake = 4

StateEstimation_state = Simulink.Bus()
  Pos: Bus: CartPos
  dPsi_radps: double
  vx_mps: double
  vy_mps: double
  ax_mps2: double
  ay_mps2: double

Odometry = Simulink.Bus()
  Position: Bus: CartPos
  Valid_b: boolean

VisualLoc_Send = Simulink.Bus()
  timeGPS_s: double
  vx_mps: double
  vy_mps: double
  dPsi_radps: double
  ResetPosition: Bus: CartPos
  ResetPosition_Valid: boolean
  Odometry: Bus: Odometry

TUMOdometryEstimationState = enum(DefaultValue="OE_OFF")
  OE_OFF = 0
  OE_NOTVALID = 1
  OE_VALID = 2

Localization_PX2Debug = Simulink.Bus()
  xGPS_m: double
  yGPS_m: double
  xVLOCraw_m: double
  yVLOCraw_m: double
  xVLOC_m: double
  yVLOC_m: double
  xEstimate_m: double
  yEstimate_m: double
  xPath_m: double
  yPath_m: double

ActuatorLimitations = Simulink.Bus()
  SteeringAngleMax_rad: double
  SteeringAngleMin_rad: double
  DriveForceMax_N: double
  DriveForceMin_N: double

TUMModeControl = Simulink.Bus()
  TUMVehicleState: Enum: TUMVehicleState
  EnableSensorFusion: boolean
  EnableControlOutputs: boolean
  EnableDriver: boolean
  EnableHardEmergencyBrake: boolean
  RequestControl: boolean

VehicleControl = Simulink.Bus()
  RequestSteeringAngle_rad: double
  RequestLongForce_N: double
  ParkBrakeActive: boolean

VehicleActuatorStatus = Simulink.Bus()
  VehicleReady: boolean
  HardwareStatus: Enum: TUMHealthStatus

V2X_Vehicle = Simulink.Bus()
  x_m: double
  y_m: double
  psi_rad: double
  vx_mps: double
  vy_mps: double
  dPsi_radps: double

V2X_Data = Simulink.Bus()
  Op1: V2X_Vehicle
  Op2: V2X_Vehicle
  Op3: V2X_Vehicle
  Op4: V2X_Vehicle

VehicleControlDisturbances = Simulink.Bus()
  kappaDist_radpm: double
  axDist_mps2: double

ControlErrors = Simulink.Bus()
  e_LateralDeviation_m: double
  de_LateralDeviationDer_mps: double
  ePsi_HeadingDeviation_rad: double
  u_ControlInput_radpm: double

TrajectoryPlanning = Simulink.Bus()
  Strategy_Status: Enum: TUMStrategyState
  Strategy_CommsStatus: Enum: TUMHealthStatus
  Trajectories_CommsStatus: Enum: TUMHealthStatus
  EmergencyTrajectory: Bus: Trajectory
  PerformanceTrajectory: Bus: Trajectory

ControllerParameter = Simulink.Bus()
  FeedbackParam: double[4]
  FB_CommsStatus: Enum: TUMHealthStatus
  FeedforwardParam: double[501]
  FF_CommsStatus: Enum: TUMHealthStatus

Planning_ControlPerformance_Feedback = Simulink.Bus()
  scale_factor: double
  v_max_mps: double
  CommsOK: boolean

StateEstimation_residuals = Simulink.Bus()
  res_xLoc1_m: double
  res_yLoc1_m: double
  res_psiLoc1_rad: double
  res_xLoc2_m: double
  res_yLoc2_m: double
  res_psiLoc2_rad: double
  res_vxVel1_mps: double
  res_vyVel1_mps: double
  res_vxVel2_mps: double
  res_vyVel2_mps: double
  res_dPsi1_radps: double
  res_dPsi2_radps: double
  res_sLoc1_m: double
  res_dLoc1_m: double
  res_sLoc2_m: double
  res_dLoc2_m: double

TUMStateEstimationState = enum(DefaultValue="SE_OFF")
  SE_OFF = 0
  SE_NORMAL = 1
  SE_BYPASS = 2
  SE_ODOM = 3
  SE_FAIL = 4

TUMStrategyState = enum(DefaultValue="S_OFF", StorageType="uint16")
  S_OFF = 0
  S_STARTUP = 10
  S_STANDSTILL = 20
  S_STANDSTILL_TRAJSEND = 25
  S_DRIVING_STARTRACE = 30
  S_DRIVING_RACE = 31
  S_DRIVING_BRAKE2STOP = 40
  S_DRIVING_EMERGENCY = 50

TrajPlanner_Send = Simulink.Bus()
  TUMVehicleState: Enum: TUMVehicleState
  BDriveMode: uint8

mvdc_state_estimation_debug = Simulink.Bus()
  StateEstimate: Bus: VehicleDynamicState
  Residuals: Bus: StateEstimation_residuals
  Diagnosis: Bus: StateEstimation_diag
  Odom: Bus: Odometry

mvdc_mue_estimation_delay_debug = Simulink.Bus()
  Position: Bus: CartPos
  FX_VehDynFL_N: double
  FX_VehDynFR_N: double
  FX_VehDynRL_N: double
  FX_VehDynRR_N: double
  FY_VehDynFL_N: double
  FY_VehDynFR_N: double
  FY_VehDynRL_N: double
  FY_VehDynRR_N: double
  FZ_VehDynFL_N: double
  FZ_VehDynFR_N: double
  FZ_VehDynRL_N: double
  FZ_VehDynRR_N: double
  FX_MFtireforceFL_N: double
  FY_MFtireforceFL_N: double
  FX_MFtireforceFLmax_N: double
  FY_MFtireforceFLmax_N: double
  FX_MFtireforceFR_N: double
  FY_MFtireforceFR_N: double
  FX_MFtireforceFRmax_N: double
  FY_MFtireforceFRmax_N: double
  FX_MFtireforceRL_N: double
  FY_MFtireforceRL_N: double
  FX_MFtireforceRLmax_N: double
  FY_MFtireforceRLmax_N: double
  FX_MFtireforceRR_N: double
  FY_MFtireforceRR_N: double
  FX_MFtireforceRRmax_N: double
  FY_MFtireforceRRmax_N: double
  TRFP_est_FLx: double
  TRFP_est_FLy: double
  TRFP_est_FRx: double
  TRFP_est_FRy: double
  TRFP_est_RLx: double
  TRFP_est_RLy: double
  TRFP_est_RRx: double
  TRFP_est_RRy: double

TUMVehicleState = enum(DefaultValue="OFF", StorageType="uint16")
  STARTUP_Init = 10
  STARTUP_WaitForSystem = 11
  STARTUP_WaitForAIDriverComms = 12
  IDLE_ActivateSensorFusion = 20
  IDLE_WaitForSensorFusion = 21
  IDLE_ActivateDriver = 22
  IDLE_WaitForDriver = 23
  IDLE_WaitForVehicle = 24
  DRIVING = 30
  EMERGENCY = 50
  HARDEMERGENCY = 60
  OFF = 0

VehicleSystemStatus = Simulink.Bus()
  Hardware: Enum: TUMHealthStatus
  AIDriver: Enum: TUMHealthStatus
  ParkBrakeApplied_b: boolean
  VehicleReady2Drive: boolean

mloc_statemachine_debug = Simulink.Bus()
  Hardware_Status: uint16
  AIDriver_Status: uint16
  ParkBrakeApplied_b: boolean
  VehicleReady2Drive: uint16
  StateEstimation_Status: uint16
  VehicleSafeStandstill: uint16
  Driver_Status: uint16
  VehicleUnresponsive: uint16
  TUMVehicleState: uint16
  EnableSensorFusion: uint16
  EnableControlOutputs: uint16
  EnableDriver: uint16
  EnableHardEmergencyBrake: uint16
  RequestControl: uint16

mvdc_mue_estimation_delay_Send = Simulink.Bus()
  Position: Bus: CartPos
  vx_mps: double
  vy_mps: double
  ax_mps2: double
  ay_mps2: double
  TRFP_est_FLx: double
  TRFP_est_FLy: double
  TRFP_est_FRx: double
  TRFP_est_FRy: double
  TRFP_est_RLx: double
  TRFP_est_RLy: double
  TRFP_est_RRx: double
  TRFP_est_RRy: double

VehicleSensorData = Simulink.Bus()
  Tz_Powertrain_Nm: double
  Fx_Powertrain_N: double
  T_WheelFL_Nm: double
  T_WheelFR_Nm: double
  T_WheelRL_Nm: double
  T_WheelRR_Nm: double
  Delta_Wheel_rad: double
  p_BrakeF_bar: double
  p_BrakeR_bar: double
  omega_WheelFL_radps: double
  omega_WheelFR_radps: double
  omega_WheelRL_radps: double
  omega_WheelRR_radps: double
  valid_Wheelspeeds_b: boolean
  x_Loc1_m: double
  y_Loc1_m: double
  z_Loc1_m: double
  phi_RollAngleLoc1_rad: double
  theta_PitchAngleLoc1_rad: double
  psi_YawAngleLoc1_rad: double
  t_EstimateLoc1_s: double
  valid_Loc1_b: boolean
  accuracy_Loc1: double[3]
  x_Loc2_m: double
  y_Loc2_m: double
  z_Loc2_m: double
  phi_RollAngleLoc2_rad: double
  theta_PitchAngleLoc2_rad: double
  psi_YawAngleLoc2_rad: double
  t_EstimateLoc2_s: double
  valid_Loc2_b: boolean
  accuracy_Loc2: double[3]
  vx_CoGVel1_mps: double
  vy_CoGVel1_mps: double
  valid_Vel1_b: boolean
  vx_CoGVel2_mps: double
  vy_CoGVel2_mps: double
  valid_Vel2_b: boolean
  ax_CoGIMU1_mps2: double
  ay_CoGIMU1_mps2: double
  az_CoGIMU1_mps2: double
  dPhi_RollRateIMU1_radps: double
  dTheta_PitchRateIMU1_radps: double
  dPsi_YawRateIMU1_radps: double
  valid_IMU1_b: boolean
  ax_CoGIMU2_mps2: double
  ay_CoGIMU2_mps2: double
  az_CoGIMU2_mps2: double
  dPhi_RollRateIMU2_radps: double
  dTheta_PitchRateIMU2_radps: double
  dPsi_YawRateIMU2_radps: double
  valid_IMU2_b: boolean

StateEstimation_diag = Simulink.Bus()
  valid_Loc1_b: boolean
  valid_Loc2_b: boolean
  valid_Vel1_b: boolean
  valid_Vel2_b: boolean
  valid_IMU1_b: boolean
  valid_IMU2_b: boolean
  fail_Loc1_b: boolean
  fail_Loc2_b: boolean
  fail_Vel1_b: boolean
  fail_Vel2_b: boolean
  fail_IMU1_b: boolean
  fail_IMU2_b: boolean

VehicleDynamicState = Simulink.Bus()
  SE_Status: Enum: TUMHealthStatus
  SE_State: Enum: TUMStateEstimationState
  Pos: Bus: CartPos
  z_m: double
  PosAccuracy: double[3]
  VelAccuracy: double[3]
  dPsi_radps: double
  vx_mps: double
  vy_mps: double
  v_mps: double
  beta_rad: double
  ax_mps2: double
  ay_mps2: double
  psi_vel_rad: double
  kappa_radpm: double
  dBeta_radps: double
  ddPsi_radps2: double
  ax_vel_mps2: double
  ay_vel_mps2: double
  lambdaFL_perc: double
  lambdaFR_perc: double
  lambdaRL_perc: double
  lambdaRR_perc: double
  alphaFL_rad: double
  alphaFR_rad: double
  alphaRL_rad: double
  alphaRR_rad: double
  DiffFRAlpha_rad: double

mloc_diag_vehicle_debug = Simulink.Bus()
  VehicleUnstable_b: boolean
  EstimatedCurrentPower_W: double
  EstimatedRequestedPower_W: double

mvdc_trajectory_driver_perf = Simulink.Bus()
  LapTime_s: double
  e_lateral_m: double
  eRMS_lateral_m: double
  ePeak_lateral_m: double
  e_heading_rad: double
  eRMS_heading_rad: double
  ePeak_heading_rad: double
  e_v_mps: double
  eRMS_v_mps: double
  ePeak_v_mps: double
  e_kappa_radpm: double
  eRMS_kappa_radpm: double
  ePeak_kappa_radpm: double

ControllerLearning_Send = Simulink.Bus()
  VehicleDynamicState: Bus: VehicleDynamicState
  PathPos: Bus: PathPos
  MeasurementIdx: uint32
  LapIdx: uint32

FailureModes = Simulink.Bus()
  BrakeSensorFMDetected_b: boolean
  BrakeSensorFM: double
  TorqueSensorFMDetected_b: boolean
  TorqueSensorFM: double
  SteeringSensorFMDetected_b: boolean
  SteeringSensorFM: double
  IMU1FMDetected_b: boolean
  IMU1FM: double
  IMU2FMDetected_b: boolean
  IMU2FM: double
  WheelspeedSensorsFMDetected_b: boolean
  WheelspeedSensorsFM: double
  Vel1FMDetected_b: boolean
  Vel1FM: double
  Vel2FMDetected_b: boolean
  Vel2FM: double
  Loc1FMDetected_b: boolean
  Loc1FM: double
  Loc2FMDetected_b: boolean
  Loc2FM: double
  VehicleFMDetected_b: boolean
  VehicleFM: double
  SteeringActuatorFMDetected_b: boolean
  SteeringActuatorFM: double

LatDistEstimation = Simulink.Bus()
  ay_DistEstimate_mps2: double
  ay_Target_mps2: double
  v_Target_mps: double

mvdc_path_feedback_debug = Simulink.Bus()
  Lat_FB_Sum_KappaReq_radpm: double
  Lat_FB_Position: double
  Lat_FB_Heading: double
  Lat_LatPosError_m: double
  Lat_LatPosError_DerAna_mps: double
  Lat_LatPosError_DerNum_mps: double
  Lat_LatPosError_DerDer_mps2: double
  Lat_LatPosError_DerDerAna_mps2: double
  Lat_LatPosError_DerDerNum_mps2: double
  Lat_all_KappaReq_radpm: double
  Lat_DistEstimate_mps2: double
  Lat_ay_Target_mps2: double
  Lat_v_Target_mps: double

MapReference = Simulink.Bus()
  GPSReference: double[4]
  InitialState: double[4]

mvdc_trajectory_driver_debug = Simulink.Bus()
  ParkBrakeActive: boolean
  DriverStatus: uint16
  EnablePathMatching: boolean
  EnableDriving: boolean
  ControllerStatus: uint16
  PathMatchingStatus: uint16
  Strategy_Status: uint16
  Trajectories_CommsStatus: Enum: TUMHealthStatus
  Strategy_CommsStatus: Enum: TUMHealthStatus

DisturbanceLearningResult = Simulink.Bus()
  ax_quantile_mps2_upper: double
  ax_quantile_mps2_lower: double
  ay_quantile_mps2_upper: double
  ay_quantile_mps2_lower: double
  alg_mean_ax: Bus: AlgMeanValueRegression
  alg_mean_ay: Bus: AlgMeanValueRegression

UDPPackages_Send = Simulink.Bus()
  BSM_Package: uint8[8]
  BSM_ActivateSend: boolean
  TG_Package: uint8[25]
  TG_ActivateSend: boolean
  VLOC_Package: uint8[96]
  VLOC_ActivateSend: boolean
  ControllerLearning_Package: uint8[120]
  ControllerLearning_ActivateSend: boolean
  StateEstimate_Package: uint8[105]
  StateEstimate_ActivateSend: boolean
  V2X_Package: uint8[75]
  V2X_ActivateSend: boolean
  tpa_mueestRT_Package: uint8[20]
  tpa_mueestRT_ActivateSend: boolean
  tpa_vdcsignals_Package: uint8[68]
  tpa_vdcsignals_ActivateSend: boolean

AlgMeanValueRegression = Simulink.Bus()
  gamma: double
  mu: double
  w: double[2]
  N: double
  count: double
  delta_w_temp: double[2]

LongDistEstimation = Simulink.Bus()
  ax_DistEstimate_mps2: double
  ax_Target_mps2: double
  VelocityActual_mps: double
  VelocityError_mps: double
  DistComp_mps2: double

mvdc_curvvel_tracking_debug = Simulink.Bus()
  Curv_TargetAy_mps2: double
  Curv_all_KappaReq_radpm: double
  Curv_FB_Dist_DeltaReq_rad: double
  Curv_FB_Diff_DeltaReq_rad: double
  Curv_FF_Kappa_DeltaReq_rad: double
  Curv_USComp_DeltaReq_rad: double
  Curv_CurvError_radpm: double
  Curv_TargetCurv_radpm: double
  Long_FB_Dist_FxReq_N: double
  Long_FF_Dist_FxReq_N: double
  Long_FB_VelDiff_FxReq_N: double
  Long_FF_Traj_FxReq_N: double
  Long_VelError_mps: double
  Long_TargetSpeed_mps: double
  Long_axTarget_mps2: double
  Long_ax_DistEstimate_mps2: double
  Long_ax_Target_mps2: double
  Long_VelocityActual_mps: double
  Req_Delta_rad: double
  Req_Fx_N: double
  ControlState: uint16
  EnableDriving: boolean
  EnableEmergency: boolean
  TCCorrectiveForce_N: double
  TCSlipDifference_perc: double
  TCProportionalForce_N: double
  TCIntegralForce_N: double
  MaximumLongForce_N: double

mvdc_dist_learning_debug = Simulink.Bus()
  ax_pred_error_mps2: double
  ay_pred_error_mps2: double
  ax_quantile_mps2_upper: double
  ax_quantile_mps2_lower: double
  ay_quantile_mps2_upper: double
  ay_quantile_mps2_lower: double
  alg_mean_ax_w1: double
  alg_mean_ax_w2: double
  alg_mean_ay_w1: double
  alg_mean_ay_w2: double
  ax_pred_mps2: double
  ay_pred_mps2: double

AlgQuantileEstimation = Simulink.Bus()
  r_est: double
  q_target: double
  lambda: double
  N: double
  count_lower: double
  count: double

Trajectory = Simulink.Bus()
  LapCnt: uint32
  TrajCnt: uint32
  s_loc_m: double[50]
  s_glob_m: double[50]
  x_m: double[50]
  y_m: double[50]
  psi_rad: double[50]
  kappa_radpm: double[50]
  v_mps: double[50]
  ax_mps2: double[50]

TargetValuesVehicleDynamics = Simulink.Bus()
  v_mps: double
  ax_mps2: double
  kappa_radpm: double
  EnableDriving: boolean
  EnableEmergency: boolean

VisualLoc = Simulink.Bus()
  CartPos: Bus: CartPos
  GPSTime_s: double
  VLOCCommsStatus: Enum: TUMHealthStatus
  Estimate_OK: uint16

UDPPackages_Rcv = Simulink.Bus()
  BSM_Package: uint8[12]
  BSM_Valid: boolean
  EmergencyTrajectory_Package: uint8[1414]
  EmergencyTrajectory_Valid: boolean
  PerformanceTrajectory_Package: uint8[1414]
  PerformanceTrajectory_Valid: boolean
  VLOC_Package: uint8[48]
  VLOC_Valid: boolean
  MapReferences_Package: uint8[48]
  MapReferences_Valid: boolean

mvdc_path_matching_debug = Simulink.Bus()
  PerformanceTrajOK_b: boolean
  EmergencyTrajOK_b: boolean
  PathPos: Bus: PathPos
  ActualTrajPoint: Bus: TrajectoryPoint

TUMPathMatchingState = enum(DefaultValue="PM_OFF")
  PM_OFF = 0
  PM_NOTVALID = 1
  PM_VALID = 2
  PM_VALID_HIGHDEVIATION = 4
  PM_VALID_VERYHIGHDEVIATION = 5
  PM_ENDREACHED = 6

TrajectoryPoint = Simulink.Bus()
  LapCnt: uint32
  TrajCnt: uint32
  PointIdx: uint16
  s_loc_m: double
  s_glob_m: double
  x_m: double
  y_m: double
  psi_rad: double
  kappa_radpm: double
  v_mps: double
  ax_mps2: double

mvdc_trajectory_driver_debug_all = Simulink.Bus()
  mvdc_path_feedback_debug: Bus: mvdc_path_feedback_debug
  mvdc_path_matching_debug: Bus: mvdc_path_matching_debug
  mvdc_trajectory_driver_debug: Bus: mvdc_trajectory_driver_debug
  mvdc_trajectory_driver_perf: Bus: mvdc_trajectory_driver_perf
  mvdc_curvvel_tracking_debug: Bus: mvdc_curvvel_tracking_debug

mvdc_vehicle_dynamics_control_debug = Simulink.Bus()
  ErrorCode: uint32
  mvdc_path_feedback_debug: Bus: mvdc_path_feedback_debug
  mvdc_path_matching_debug: Bus: mvdc_path_matching_debug
  mvdc_trajectory_driver_debug: Bus: mvdc_trajectory_driver_debug
  mvdc_trajectory_driver_perf: Bus: mvdc_trajectory_driver_perf
  mvdc_curvvel_tracking_debug: Bus: mvdc_curvvel_tracking_debug
  mvdc_state_estimation_debug: Bus: mvdc_state_estimation_debug
  mloc_statemachine_debug: Bus: mloc_statemachine_debug
  mloc_diag_vehicle_debug: Bus: mloc_diag_vehicle_debug
  VehicleSensorData: Bus: VehicleSensorData
  Time_s: double