% Simulink data dictionary PackUDP.sldd
% references modelconfig.sldd
% references TUM_interfaces.sldd

P_MLOC_NumberOfNoSendFramesVLOC = Simulink.Parameter(1)
x = Simulink.Parameter([])
P_MLOC_NumberOfNoSendFramesTG = Simulink.Parameter(0)
P_MLOC_NumberOfNoSendFramesBSM = Simulink.Parameter(0)
P_MLOC_NumberOfNoSendFramesLocalization = Simulink.Parameter(4)
P_MLOC_NumberOfNoSendFramesCL = Simulink.Parameter(0)
P_MLOC_NumberOfNoSendFramesStateEstimate = Simulink.Parameter(4)