% Simulink data dictionary UDPPortConfig.sldd

VisualLocalizationSend_Port = 44440
VisualLocalizationRcv_Port = 44441
BehaviorStatemachineRcv_Port = 44446
BehaviorStatemachineSend_Port = 44445
RMCStateDebugInfo_Port = 44447
TrajectoryGenerationSend_Port = 44444
PerformanceTrajectoryRcv_Port = 33333
EmergencyPathRcv_Port = 33334
PerformanceDebug_Port = 44448
LocalizationDebug_Port = 44449
VisualBoundsRcv_Port = 44442
ControllerParamRcv_Port = 44451
ControllerLearningSend_Port = 44452
ControllerTrajAdjustParam_RcvPort = 44453
LocalTrajPlannerSend_Port = 44454
V2XSend_Port = 44455