% Simulink data dictionary pa_mvdc_path_feedback.sldd

P_VDC_KappaFFPathFeedback_Ts = Simulink.Parameter(0.03)
P_VDC_UseNumDerivativePathFeedback_b = Simulink.Parameter(false, DataType="boolean")
P_VDC_LatKappaMaxFB_radpm = Simulink.Parameter(0.1)
P_VDC_LongFF_PT1_s = Simulink.Parameter(0.03)
P_VDC_NumDerivativeTFilter_s = Simulink.Parameter(0.05)
P_VDC_UseSSCDynamicsComp_b = Simulink.Parameter(true, DataType="boolean")
P_VDC_MinSpeedGainCorrection_mps = Simulink.Parameter(10)
P_VDC_UseLongFF_PT1_b = Simulink.Parameter(false, DataType="boolean")
P_VDC_LatDamping = Simulink.Parameter(0.6, Min=0)
P_VDC_LatConvergence = Simulink.Parameter(2, Min=0)
P_VDC_UseBetaFeedback_b = Simulink.Parameter(true, DataType="boolean")