% Simulink data dictionary pa_mvdc_path_matching.sldd

P_VDC_CurvatureForesight_s = Simulink.Parameter(0.004)
P_VDC_LocalFFCalculationActive_b = Simulink.Parameter(false, DataType="boolean")
P_VDC_PathMatchingTimeOut = Simulink.Parameter(0.5)
P_VDC_apSafetyChecks = Simulink.Parameter(1)
P_VDC_axSafetyChecks_mps2 = Simulink.Parameter(13.5)
P_VDC_aySafetyChecks_mps2 = Simulink.Parameter(13.5)
P_VDC_PowertrainForesight_s = Simulink.Parameter(0)
P_VDC_LateralPathDeviationMax_m = Simulink.Parameter(3)
P_VDC_HeadingPathDeviationMax_rad = Simulink.Parameter(1)