% Simulink data dictionary pa_mvdc_estimation_preprocessing.sldd

P_VDC_ActivateOnlineDiagnosis = Simulink.Parameter(true, DataType="boolean")
P_VDC_DebounceSensorFailure = Simulink.Parameter(25)
P_VDC_SensorFailuresLatched = Simulink.Parameter(repmat(0, 1, 6), DataType="boolean")
P_VDC_EnableSensorsForFusion = Simulink.Parameter(repmat(1, 1, 6), DataType="boolean")
P_MLOC_OdometryManualReset_y_m = Simulink.Parameter(100)
P_MLOC_OdometryManualReset_x_m = Simulink.Parameter(50)
P_MLOC_OdometryManualReset_psi_rad = Simulink.Parameter(0)
P_MLOC_OdometryResetMode = Simulink.Parameter(2)
P_MLOC_Loc1DelayCompTime_s = Simulink.Parameter(0)
P_MLOC_Loc2DelayCompTime_s = Simulink.Parameter(0)