% Simulink data dictionary pa_mvdc_state_estimation.sldd

P_VDC_LowPassRawSens = Simulink.Parameter(0.05)
P_VDC_SEResetSamples = Simulink.Parameter(124)
P_MLOC_MaxWheelslip_perc = Simulink.Parameter(300, Min=0)
P_MLOC_MaxWheelslipangle_rad = Simulink.Parameter(1.570796, Min=0)
P_MLOC_MinWheelslip_perc = Simulink.Parameter(-300, Max=0)
P_MLOC_MinWheelslipangle_rad = Simulink.Parameter(-1.570796, Max=0)
P_VDC_ActivateSensorFusion = Simulink.Parameter(true, DataType="boolean", Min=0, Max=1)
P_VDC_CurvatureEstimateMax_radpm = Simulink.Parameter(0.3)
P_VDC_CurvatureEstimationMode = Simulink.Parameter(1)
P_VDC_LowPassT1Curvature = Simulink.Parameter(0.06)
P_VDC_LowPassT1Wheelspeeds = Simulink.Parameter(0.03)