% Simulink data dictionary Berlin2019.sldd

Raceline = struct(
  s_m=[0; 1.9994848; 3.9989696; 5.9984545; 7.9979393; 9.9974241; 11.9969089; 13.9963938; 15.9958786; 17.9953634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 6162],
  x_m=[103.6056152; 102.2644888; 100.9269123; 99.5929161; 98.2625352; 96.9357955; 95.6127272; 94.2933671; 92.9777405; 91.6658782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 0],
  y_m=[142.925544; 141.4425372; 139.9563249; 138.4668954; 136.974242; 135.4783482; 133.9792021; 132.4767992; 130.9711222; 129.4621597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 0],
  psi_rad=[2.4051999; 2.4075844; 2.4099841; 2.4123991; 2.4148292; 2.4172746; 2.4197353; 2.4222112; 2.4247024; 2.4272089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 0],
  kappa_radpm=[0.0011888; 0.0011964; 0.001204; 0.0012116; 0.0012192; 0.0012268; 0.0012345; 0.0012421; 0.0012497; 0.0012574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 0],
  vx_mps=[41.508048; 41.6472307; 41.7784501; 41.8993911; 42.0084921; 42.1047508; 42.1875837; 42.2567141; 42.3120913; 42.3547678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 0],
  ax_mps2=[2.8941888; 2.737472; 2.5306732; 2.2891975; 2.0246798; 1.7459934; 1.4597928; 1.1710982; 0.9035545; 0.6976774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 0],
  delta_rad=repmat(0, 5000, 1),
  F_N=repmat(0, 5000, 1),
  ValidPointCnt=1163,
  s_m_end=2323.4013665)

Raceline_Op1 = struct(
  s_m=[0; 1.9994848; 3.9989696; 5.9984545; 7.9979393; 9.9974241; 11.9969089; 13.9963938; 15.9958786; 17.9953634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 6162],
  x_m=[103.6056152; 102.2644888; 100.9269123; 99.5929161; 98.2625352; 96.9357955; 95.6127272; 94.2933671; 92.9777405; 91.6658782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 0],
  y_m=[142.925544; 141.4425372; 139.9563249; 138.4668954; 136.974242; 135.4783482; 133.9792021; 132.4767992; 130.9711222; 129.4621597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 0],
  psi_rad=[2.4051999; 2.4075844; 2.4099841; 2.4123991; 2.4148292; 2.4172746; 2.4197353; 2.4222112; 2.4247024; 2.4272089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 0],
  kappa_radpm=[0.0011888; 0.0011964; 0.001204; 0.0012116; 0.0012192; 0.0012268; 0.0012345; 0.0012421; 0.0012497; 0.0012574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 0],
  vx_mps=[41.508048; 41.6472307; 41.7784501; 41.8993911; 42.0084921; 42.1047508; 42.1875837; 42.2567141; 42.3120913; 42.3547678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 0],
  ax_mps2=[2.8941888; 2.737472; 2.5306732; 2.2891975; 2.0246798; 1.7459934; 1.4597928; 1.1710982; 0.9035545; 0.6976774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 0],
  delta_rad=repmat(0, 5000, 1),
  F_N=repmat(0, 5000, 1),
  ValidPointCnt=1163,
  s_m_end=2323.4013665)

Raceline_Op2 = struct(
  s_m=[0; 1.9994848; 3.9989696; 5.9984545; 7.9979393; 9.9974241; 11.9969089; 13.9963938; 15.9958786; 17.9953634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 6162],
  x_m=[103.6056152; 102.2644888; 100.9269123; 99.5929161; 98.2625352; 96.9357955; 95.6127272; 94.2933671; 92.9777405; 91.6658782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 0],
  y_m=[142.925544; 141.4425372; 139.9563249; 138.4668954; 136.974242; 135.4783482; 133.9792021; 132.4767992; 130.9711222; 129.4621597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 0],
  psi_rad=[2.4051999; 2.4075844; 2.4099841; 2.4123991; 2.4148292; 2.4172746; 2.4197353; 2.4222112; 2.4247024; 2.4272089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 0],
  kappa_radpm=[0.0011888; 0.0011964; 0.001204; 0.0012116; 0.0012192; 0.0012268; 0.0012345; 0.0012421; 0.0012497; 0.0012574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 0],
  vx_mps=[41.508048; 41.6472307; 41.7784501; 41.8993911; 42.0084921; 42.1047508; 42.1875837; 42.2567141; 42.3120913; 42.3547678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 0],
  ax_mps2=[2.8941888; 2.737472; 2.5306732; 2.2891975; 2.0246798; 1.7459934; 1.4597928; 1.1710982; 0.9035545; 0.6976774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 0],
  delta_rad=repmat(0, 5000, 1),
  F_N=repmat(0, 5000, 1),
  ValidPointCnt=1163,
  s_m_end=2323.4013665)

s0_m_Op1 = 0
s0_m_Op2 = 0
s0_m_Op3 = 0
s0_m_Op4 = 0
velGain_Op1 = 0
velGain_Op2 = 0
velGain_Op3 = 0
velGain_Op4 = 0
x0_vehiclepose = [103.6056152 142.925544 2.4051999]
x0_vehiclepose_Op1 = [103.6056152 142.925544 2.4051999]
x0_vehiclepose_Op2 = [103.6056152 142.925544 2.4051999]
x0_vehiclepose_Op3 = [103.6056152 142.925544 2.4051999]
x0_vehiclepose_Op4 = [103.6056152 142.925544 2.4051999]